# Grasshopper definition Display_Preview.ghx (Grasshopper 1.0.7)

# ---- group: Create Material
# Display Preview
transparency = Slider(0.5, range=0..1)
shine = Slider(1, range=0..100)
# GH#: A C# dictionary of Grasshopper3D components.
# 
# This file contains a category of Grasshopper components, and a mirroring C#/RhinoCommon implementation.
# 
# This is an educational project initiated by students/faculty of GSD-6338: Introduction to Computational Design, at the Harvard Graduate School of Design.
# 
# More information: {{project link}}
swatch = ColourSwatch(SwatchColor=RGB(93, 255, 255))
swatch_2 = ColourSwatch(SwatchColor=RGB(255, 255, 255))
swatch_3 = ColourSwatch(SwatchColor=RGB(114, 89, 255))
material = CreateMaterial(Diffuse=swatch, Specular=swatch_2, Emission=swatch_3, Transparency=transparency, Shine=shine)
gh_material = CSharpScript(Kd=swatch, Ks=swatch_2, Ke=swatch_3, T=transparency, S=shine)  # -> out, M; inputs Kd: Color, Ks: Color, Ke: Color, T: Double, S: Int32
# ---------- gh_material: C# ----------
    // Component written by @thekaushikls

    // This component helps create a custom Display Material from
    // DiffuseColor(Kd), SpecularColor(Ks), EmissionColor(Ke),
    // Transparency(T) and Shine(S).

    Rhino.Display.DisplayMaterial newMaterial = new Rhino.Display.DisplayMaterial(Kd, T);
    newMaterial.Specular = Ks;
    newMaterial.Emission = Ke;
    newMaterial.Shine = S;

    // Rhino material needs to be converted to GH_Material to use inside GH.
    // Grasshopper.Kernel.Types.GH_Material
    GH_Material newGHMaterial = new GH_Material(newMaterial);

    // Output
    M = newGHMaterial;
# ---------- end gh_material ----------
samplegeometry = Geometry(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)
panel = Panel(material)
panel_2 = Panel(gh_material.M)
samplegeometry_2 = Geometry(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)
preview = CustomPreview(Geometry=samplegeometry, Material=material)
preview_2 = CustomPreview(Geometry=samplegeometry_2, Material=gh_material.M)
